# Grasshopper definition SerializeToFasterReadableJsonNoMongo.gh (Grasshopper 1.0.7)
# plug-ins: BH.UI.Grasshopper

# ----
# Convert Json file obtained with Mongo (Serializer_Engine)
# to a faster-deserializable Json file.
# The files exported via Mongo include the type of the object only as full name, not as AssemblyQualifiedName.
# This limits their deserialzation, which can only work if the context has all the needed DLLs loaded.
# Because it's not possible to know which one are needed, all are loaded, and this can be extremely slow, too much for running quick tests.
# 
# This script loads a Json serialized via Mongo, deserializes it, then the same objects are written to another Json,
# this time using Newtonsoft.Json with `TypenameHandling.Auto` which includes the AssemblyQualifiedName in the Json.
# When deserializing, this dynamically loads whatever assembly is needed to get the type out.
# Read Json file originally exported via Mongo (Serializer_Engine)
panel = Panel("C:\Users\alombardi\GitHub\DiffingTests_Prototypes\Datasets\")
concat = Concatenate(FragmentA=panel, FragmentB="RevitDiffing-duplicateIdsStructuralObjs_following.json")
readfromjsonfile = ReadFromJsonFile(FilePath=concat, Active=Toggle(False), Component="{ .ReadFromJsonFile")

# ----
# Write another Json file
# which includes the AssemblyQualifiedName
panel_2 = Panel("C:\Users\alombardi\GitHub\DiffingTests_Prototypes\Datasets\RevitDiffing-duplicateIdsStructuralObjs_following1.json")
dam = DataDam(DataA=readfromjsonfile, BufferDelay=10000000, BufferMode=0)
serialisetojsonfile = SerialiseToJsonFile(Obj=dam, FilePath=panel_2, Component="{ .SerialiseToJsonFile")
